# Grasshopper definition charts_01.gh (Grasshopper 1.0.7)
# plug-ins: Human

number_slider = Slider(9, range=0..10)
number_slider_2 = Slider(17, range=0..100)
crv = Curve(<curve referenced from the Rhino model>)
dom = ConstructDomain(DomainStart=Slider(11, range=0..100), DomainEnd=Slider(100, range=0..100))
divide = DivideCurve(Curve=crv, Count=number_slider_2, Kinks=False)  # -> Points, Tangents, Parameters
random = Random(Range=dom, Number=expr("x+1", number_slider_2), Seed=Slider(476, range=0..1000))
Y = UnitY(Factor=1)
int = Integer(random)
multiplication = Multiplication(A=int, B=Slider(0.187, range=0..1))
line = LineSDL(Start=divide.Points, Direction=Y, Length=multiplication)
end = EndPoints(Curve=line)  # -> Start, End
pline = PolyLine(Vertices=end.End, Closed=False)
dash = DashPattern(Curve=reparameterize(pline), Pattern=Slider(0.156, range=0..1))  # -> Dashes, Gaps
previewlw = CustomPreviewLineweights(
    Geometry=dash.Dashes,
    Shader=ColourSwatch(SwatchColor=RGB(153, 0, 255)),
    Thickness=Slider(2, range=0..10),
    Absolute=False)
