# Grasshopper definition mesh-grid-salva.gh (Grasshopper 1.0.7)
# plug-ins: Tarsier, LunchBox, Volvox, Kangaroo Components

srf = Surface(<surface referenced from the Rhino model>)
brep = Brep([<brep referenced from the Rhino model> x2])
brep_2 = Brep(<brep referenced from the Rhino model>)
brep_3 = Brep([<brep referenced from the Rhino model> x8])
brep_4 = Brep([<brep referenced from the Rhino model> x2])
brep_5 = Brep([<brep referenced from the Rhino model> x6])
brep_6 = Brep([<brep referenced from the Rhino model> x33])
brep_7 = Brep([<brep referenced from the Rhino model> x22])
debrep = DeconstructBrep(Brep=brep)  # -> Faces, Edges, Vertices
debrep_2 = DeconstructBrep(Brep=brep_2)  # -> Faces, Edges, Vertices
debrep_3 = DeconstructBrep(Brep=[brep_3, brep_4])  # -> Faces, Edges, Vertices
debrep_4 = DeconstructBrep(Brep=brep_5)  # -> Faces, Edges, Vertices
srf_2 = Surface(<surface referenced from the Rhino model>)
debrep_5 = DeconstructBrep(Brep=brep_6)  # -> Faces, Edges, Vertices
area = Area(Geometry=debrep.Faces)  # -> Area, Centroid
bnd = Bounds(Numbers=area.Area)  # -> flatten(Domain)
debrep_6 = DeconstructBrep(Brep=brep_7)  # -> Faces, Edges, Vertices
crv = Curve([<curve referenced from the Rhino model> x15])
panel = Panel(bnd)
popgeo = PopulateGeometry(Geometry=debrep_2.Faces, Count=Slider(100, range=0..10000), Seed=1)  # -> flatten(Population)
trim = TrimWithRegion(Curve=crv, Region=srf_2)  # -> flatten(Inside), Outside
popgeo_2 = PopulateGeometry(Geometry=debrep_4.Faces, Count=Slider(500, range=0..10000), Seed=1)  # -> flatten(Population)
popgeo_3 = PopulateGeometry(Geometry=debrep_3.Faces, Count=Slider(500, range=0..10000), Seed=1)  # -> flatten(Population)
smaller = SmallerThan(FirstNumber=area.Area, SecondNumber=Slider(0.3, range=0..1))  # -> SmallerThan, OrEqualTo
popgeo_4 = PopulateGeometry(Geometry=debrep_5.Faces, Count=Slider(500, range=0..10000), Seed=1)  # -> flatten(Population)
popgeo_5 = PopulateGeometry(Geometry=debrep_6.Faces, Count=Slider(100, range=0..10000), Seed=1)  # -> flatten(Population)
cull = CullPattern(List=debrep.Faces, CullPattern=invert(smaller.SmallerThan))
crv_2 = Curve(trim.Inside)
rec = Rectangle(srf_2)
cull_2 = CullPattern(List=debrep.Faces, CullPattern=smaller.SmallerThan)
popgeo_6 = PopulateGeometry(Geometry=cull, Count=Slider(1000, range=0..10000), Seed=1)  # -> flatten(Population)
explode = Explode(Curve=rec, Recursive=True)  # -> Segments, Vertices
popgeo_7 = PopulateGeometry(Geometry=cull_2, Count=Slider(100, range=0..10000), Seed=1)  # -> flatten(Population)
len = Length(Curve=explode.Segments)

# ---- group: path and start
lng = ListLength(List=crv_2)
dom = ConstructDomain(DomainStart=Slider(0.2, range=0..1), DomainEnd=Slider(0.3, range=0..1))
len_2 = Length(Curve=crv_2)
random = Random(Range=dom, Number=lng, Seed=2)
division = Division(A=len_2, B=random)
ma = MassAddition(Input=division)  # -> Result, PartialResults
multiplication = Multiplication(A=ma.Result, B=Slider(0.66, range=0..1))
popgeo_8 = PopulateGeometry(Geometry=crv_2, Count=division, Seed=1)
random_2 = Random(Range=multiplication, Number=lng, Seed=2)
alongcrv = SortAlongCurve(Points=popgeo_8, Curve=graft(crv_2))  # -> simplify(Points), Indices
int = Integer(graft(random_2))

# ---- group: Profile
crv_3 = Curve(crv_2)
lng_2 = ListLength(List=crv_3)
repeat = RepeatData(Data="3", Length=lng_2)
series = Series(Start=0, Step=1, Count=lng_2)
panel_2 = Panel("""0
1""")
panel_3 = Panel("""0
1
2
3""")
panel_4 = Panel("""0
1
2
3
4
5""")
random_3 = Random(Range="6", Number=repeat, Seed=series)  # -> simplify(Random)
item = ListItem(List=random_3, Index=0, Wrap=True)  # -> Item, Item1, Item2
item_2 = ListItem(List=panel_2, Index=item.Item, Wrap=True)
item_3 = ListItem(List=panel_3, Index=item.Item1, Wrap=True)
item_4 = ListItem(List=panel_4, Index=item.Item2, Wrap=True)
merge = Merge(Data1=item_2, Data2=item_3, Data3=item_4)

# ----
division_2 = Division(A=len, B=Slider(0.25, range=0..1))
cloud = ConstructCloud(Points=popgeo_6)
cloud_2 = ConstructCloud(Points=popgeo_7)
cloud_3 = ConstructCloud(Points=popgeo)
cloud_4 = ConstructCloud(Points=popgeo_3)
cloud_5 = ConstructCloud(Points=popgeo_2)
cloud_6 = ConstructCloud(Points=popgeo_4)
round = Round(Number=division_2)  # -> Nearest, Floor, Ceiling
panel_5 = Panel("""M
F""")
panel_6 = Panel("""1
2
3
4""")
panel_7 = Panel("""CA
IN
AS
ME
AF
OT""")
item_5 = ListItem(List=round.Nearest, Index=0, Wrap=True)  # -> Item, Item1, Item2
pt = Point([popgeo_6, popgeo_7, popgeo, popgeo_3, popgeo_2, popgeo_5])
merge_2 = Merge(Data1=item_5.Item, Data2=item_5.Item1)
mplane = MeshPlane(Boundary=srf_2, WidthCount=item_5.Item, HeightCount=item_5.Item1)  # -> Mesh, Area
mirror = Mirror(MirrorStrength=100)
faceb = FaceBoundaries(Mesh=mplane.Mesh)
tstat = TreeStatistics(Tree=popgeo_8)  # -> Paths, Length, Count
range = Range(Domain=Domain(0, 0.5), Steps=expr("x-1", tstat.Count))
lng_3 = ListLength(List=popgeo_8)
join = TextJoin(Text=merge, Join=";")  # -> flatten(Result)
pt_2 = Point(simplify(alongcrv.Points))
area_2 = Area(Geometry=faceb)  # -> Area, Centroid
addition = Addition(A=int, B=graft(range))
area_3 = Area(Geometry=faceb)  # -> Area, Centroid
series_2 = Series(Start=addition, Step=1, Count=lng_3)  # -> simplify(Series)
repeat_2 = RepeatData(Data=graft(join), Length=lng_3)  # -> simplify(Data)
cp = ClosestPoint(Point=pt_2, Cloud=area_2.Centroid)  # -> ClosestPoint, simplify(CPIndex), Distance
brep_8 = Brep([<brep referenced from the Rhino model> x6])
brep_9 = Brep([<brep referenced from the Rhino model> x39])
sort = SortList(Keys=flatten(series_2), ValuesA=flatten(cp.CPIndex), ValuesB=flatten(repeat_2))  # -> Keys, ValuesA, ValuesB
pt_3 = Point([<point referenced from the Rhino model> x8])
number_slider = Slider(50000, range=0..1000000)
number_slider_2 = Slider(30000, range=0..1000000)
mesh = MeshBrep(
    Brep=brep_9,
    Settings={GridMaxCount=0, GridMinCount=16, JaggedSeams=False, MaxEdgeLength=0, MinEdgeLength=0.0001, MinTolerance=0, Refine=True, RefineAngle=0, RelativeTolerance=0.65, SimplePlanes=True, Tolerance=0})
mesh_2 = MeshBrep(
    Brep=brep_8,
    Settings={GridMaxCount=0, GridMinCount=16, JaggedSeams=False, MaxEdgeLength=0, MinEdgeLength=0.0001, MinTolerance=0, Refine=True, RefineAngle=0, RelativeTolerance=0.65, SimplePlanes=True, Tolerance=0})
round_2 = Round(Number=sort.Keys)  # -> Nearest, Floor, Ceiling
mjoin = MeshJoin(Meshes=mesh)
mjoin_2 = MeshJoin(Meshes=mesh_2)
popmesh = PopulateMesh(Mesh=mjoin, Amount=number_slider, Normals=False, Seed=2)
popmesh_2 = PopulateMesh(Mesh=mjoin_2, Amount=number_slider_2, Normals=False, Seed=2)

panel_8 = Panel(";")
panel_9 = Panel("""X
Y""")
join_2 = TextJoin(Text=merge_2, Join=panel_8)
join_3 = TextJoin(Text=panel_9, Join=panel_8)
merge_3 = Merge(Data1=join_3, Data2=join_2)  # -> flatten(Result)
panel_10 = Panel(merge_3)

geo = Geometry([<brep referenced from the Rhino model> x3])
pt_4 = Point(area_2.Centroid)
pdecon = Deconstruct(Point=pt_4)  # -> XComponent, YComponent, ZComponent
index = ItemIndex(List=pt_4, Item=pt_4)
pull = PullPoint(Point=pt_4, Geometry=geo, ClosestOnly=False)  # -> ClosestPoint, Distance
item_6 = ListItem(List=pull.Distance, Index=0, Wrap=True)  # -> flatten(Item), flatten(Item1), flatten(Item2)
concat = Concatenate(
    FragmentD=index,
    FragmentA=pdecon.XComponent,
    FragmentB=pdecon.ZComponent,
    FragmentC=pdecon.YComponent,
    FragmentE=item_6.Item,
    FragmentF=item_6.Item1,
    FragmentG=item_6.Item2,
    JoinSeparator=";")
merge_4 = Merge(Data1="id;X;Y;Z;dist1;dist2;dist3", Data2=concat)  # -> flatten(Result)
panel_11 = Panel(merge_4)

swatch = ColourSwatch(SwatchColor=RGB(204, 200, 200))
swatch_2 = ColourSwatch(SwatchColor=RGB(255, 255, 255))
deconstruct = DeconstructPointCloud(PointCloud=popmesh)  # -> Points, Colours, Normals
deconstruct_2 = DeconstructPointCloud(PointCloud=popmesh_2)  # -> Points, Colours, Normals
repeat_3 = RepeatData(Data=swatch, Length=number_slider)
repeat_4 = RepeatData(Data=swatch, Length=number_slider_2)
construct = ConstructPointCloud(Points=deconstruct.Points, Colours=repeat_3)
number_slider_3 = Slider(0.5, range=0..1)
construct_2 = ConstructPointCloud(Points=deconstruct_2.Points, Colours=repeat_4)
preview = PreviewPointCloud(PointCloud=construct_2, Weight=number_slider_3)
preview_2 = PreviewPointCloud(PointCloud=construct, Weight=number_slider_3)
merge_5 = Merge()
panel_12 = Panel("grid_values.json")

merge_6 = MergePointClouds(PointClouds=[construct, construct_2])
deconstruct_3 = DeconstructPointCloud(PointCloud=merge_6)  # -> Points, Colours, Normals
pdecon_2 = Deconstruct(Point=pt)  # -> XComponent, YComponent, ZComponent
concat_2 = Concatenate(FragmentA=pdecon_2.XComponent, FragmentB=pdecon_2.ZComponent, FragmentC=pdecon_2.YComponent, JoinSeparator=";")
merge_7 = Merge(Data1="X;Y;Z", Data2=concat_2)  # -> flatten(Result)
panel_13 = Panel(merge_7)

path = FilePath("C:\Users\secg\Documents\Noumena\projects\221222_NEX_GRUPOSALINAS\04_UI\NEX-UI-c2a8a364ba652091d0f82dd2396771d7a5440c39\models\json\")

data = Data(flatten(sort.ValuesB))
panel_14 = Panel(";")
split = TextSplit(Text=data, Separators=panel_14)  # -> simplify(Result)
merge_8 = Merge(Data1=graft(round_2.Floor), Data2=graft(sort.ValuesA))  # -> simplify(Result)
data_2 = Data(split)
ins = InsertItems(List=data_2, Item=merge_8, Indices="0", Wrap=True)
flip = FlipMatrix(Data=ins)
panel_15 = Panel("""timestamp
id
gender
age
group""")
datatable = CreateDataTable(TableName="data", TableHeaders=panel_15, ValueTree=simplify(flip))  # -> flatten(DataTable)
path_2 = FilePath("C:\Users\nerii\Desktop\Work\Noumena\NEX-UI\Nex_viz\models\json\")
concat_3 = Concatenate(FragmentA=path, FragmentB="grid_values_10.json")
dataset = CreateDataSet(DataSetName="data", DataTables=datatable)
path_3 = FilePath(concat_3)
json = CreateJSON(WriteJSON=Button(), FilePath=path_3, DataSet=dataset)

panel_16 = Panel("""X;Y;Z
17.345852;0;12.985688
24.879693;0;15.991821
23.901891;0;8.977426
16.625187;0;7.405127
20.007527;0;9.325776
20.435495;0;14.568391
15.015772;0;10.212269
22.933237;0;11.491371
17.473834;0;15.586952
15.012151;0;13.922354
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""")
panel_17 = Panel(path)
cull_i = CullIndex(List=panel_16, Indices="0", Wrap=True)
split_2 = TextSplit(Text=cull_i)
