# Grasshopper definition mesh-grid-salva_product.gh (Grasshopper 1.0.7)
# plug-ins: Tarsier, LunchBox, Volvox, Kangaroo Components

srf = Surface(<surface referenced from the Rhino model>)
brep = Brep([<brep referenced from the Rhino model> x2])
brep_2 = Brep(<brep referenced from the Rhino model>)
brep_3 = Brep([<brep referenced from the Rhino model> x8])
brep_4 = Brep([<brep referenced from the Rhino model> x2])
brep_5 = Brep([<brep referenced from the Rhino model> x6])
brep_6 = Brep([<brep referenced from the Rhino model> x33])
brep_7 = Brep([<brep referenced from the Rhino model> x22])
debrep = DeconstructBrep(Brep=brep)  # -> Faces, Edges, Vertices
debrep_2 = DeconstructBrep(Brep=brep_2)  # -> Faces, Edges, Vertices
debrep_3 = DeconstructBrep(Brep=[brep_3, brep_4])  # -> Faces, Edges, Vertices
debrep_4 = DeconstructBrep(Brep=brep_5)  # -> Faces, Edges, Vertices
srf_2 = Surface(<surface referenced from the Rhino model>)
srf_3 = Surface(<surface referenced from the Rhino model>)
debrep_5 = DeconstructBrep(Brep=brep_6)  # -> Faces, Edges, Vertices
area = Area(Geometry=debrep.Faces)  # -> Area, Centroid
bnd = Bounds(Numbers=area.Area)  # -> flatten(Domain)
debrep_6 = DeconstructBrep(Brep=brep_7)  # -> Faces, Edges, Vertices
crv = Curve([<curve referenced from the Rhino model> x15])
crv_2 = Curve([<curve referenced from the Rhino model> x15])
panel = Panel(bnd)
trim = TrimWithRegion(Curve=crv, Region=srf_2)  # -> flatten(Inside), Outside
popgeo = PopulateGeometry(Geometry=debrep_2.Faces, Count=Slider(100, range=0..10000), Seed=1)  # -> flatten(Population)
trim_2 = TrimWithRegion(Curve=crv_2, Region=srf_3)  # -> flatten(Inside), Outside
popgeo_2 = PopulateGeometry(Geometry=debrep_4.Faces, Count=Slider(500, range=0..10000), Seed=1)  # -> flatten(Population)
popgeo_3 = PopulateGeometry(Geometry=debrep_3.Faces, Count=Slider(500, range=0..10000), Seed=1)  # -> flatten(Population)
smaller = SmallerThan(FirstNumber=area.Area, SecondNumber=Slider(0.3, range=0..1))  # -> SmallerThan, OrEqualTo
popgeo_4 = PopulateGeometry(Geometry=debrep_5.Faces, Count=Slider(500, range=0..10000), Seed=1)  # -> flatten(Population)
popgeo_5 = PopulateGeometry(Geometry=debrep_6.Faces, Count=Slider(100, range=0..10000), Seed=1)  # -> flatten(Population)
crv_3 = Curve(trim.Inside)
cull = CullPattern(List=debrep.Faces, CullPattern=invert(smaller.SmallerThan))
rec = Rectangle(srf_2)
crv_4 = Curve(trim_2.Inside)
rec_2 = Rectangle(srf_3)
cull_2 = CullPattern(List=debrep.Faces, CullPattern=smaller.SmallerThan)
explode = Explode(Curve=rec, Recursive=True)  # -> Segments, Vertices
popgeo_6 = PopulateGeometry(Geometry=cull, Count=Slider(1000, range=0..10000), Seed=1)  # -> flatten(Population)
explode_2 = Explode(Curve=rec_2, Recursive=True)  # -> Segments, Vertices
popgeo_7 = PopulateGeometry(Geometry=cull_2, Count=Slider(100, range=0..10000), Seed=1)  # -> flatten(Population)
len = Length(Curve=explode.Segments)
crv_5 = Curve(crv_3)
len_2 = Length(Curve=explode_2.Segments)

# ---- group: path and start
lng = ListLength(List=crv_4)
dom = ConstructDomain(DomainStart=Slider(0.2, range=0..1), DomainEnd=Slider(0.3, range=0..1))
len_3 = Length(Curve=crv_4)
random = Random(Range=dom, Number=lng, Seed=2)
division = Division(A=len_3, B=random)
ma = MassAddition(Input=division)  # -> Result, PartialResults
multiplication = Multiplication(A=ma.Result, B=Slider(0.66, range=0..1))
popgeo_8 = PopulateGeometry(Geometry=crv_4, Count=division, Seed=1)
random_2 = Random(Range=multiplication, Number=lng, Seed=2)
alongcrv = SortAlongCurve(Points=popgeo_8, Curve=graft(crv_4))  # -> simplify(Points), Indices
int = Integer(graft(random_2))

# ---- group: Profile
crv_6 = Curve(crv_4)
lng_2 = ListLength(List=crv_6)
repeat = RepeatData(Data="3", Length=lng_2)
series = Series(Start=0, Step=1, Count=lng_2)
panel_2 = Panel("""0
1""")
panel_3 = Panel("""0
1
2
3""")
panel_4 = Panel("""0
1
2
3
4
5""")
random_3 = Random(Range="6", Number=repeat, Seed=series)  # -> simplify(Random)
item = ListItem(List=random_3, Index=0, Wrap=True)  # -> Item, Item1, Item2
item_2 = ListItem(List=panel_2, Index=item.Item, Wrap=True)
item_3 = ListItem(List=panel_3, Index=item.Item1, Wrap=True)
item_4 = ListItem(List=panel_4, Index=item.Item2, Wrap=True)
merge = Merge(Data1=item_2, Data2=item_3, Data3=item_4)

# ----
lng_3 = ListLength(List=crv_5)
division_2 = Division(A=len, B=Slider(0.25, range=0..1))
division_3 = Division(A=len_2, B=Slider(0.25, range=0..1))
cloud = ConstructCloud(Points=popgeo_6)
cloud_2 = ConstructCloud(Points=popgeo_7)
cloud_3 = ConstructCloud(Points=popgeo)
cloud_4 = ConstructCloud(Points=popgeo_3)
cloud_5 = ConstructCloud(Points=popgeo_2)
cloud_6 = ConstructCloud(Points=popgeo_4)
repeat_2 = RepeatData(Data="3", Length=lng_3)
round = Round(Number=division_2)  # -> Nearest, Floor, Ceiling
lng_4 = ListLength(List=crv_3)
dom_2 = ConstructDomain(DomainStart=Slider(0.2, range=0..1), DomainEnd=Slider(0.3, range=0..1))
round_2 = Round(Number=division_3)  # -> Nearest, Floor, Ceiling
series_2 = Series(Start=0, Step=1, Count=lng_3)
panel_5 = Panel("""M
F""")
panel_6 = Panel("""1
2
3
4""")
panel_7 = Panel("""CA
IN
AS
ME
AF
OT""")
item_5 = ListItem(List=round.Nearest, Index=0, Wrap=True)  # -> Item, Item1, Item2
len_4 = Length(Curve=crv_3)
random_4 = Random(Range=dom_2, Number=lng_4, Seed=2)
item_6 = ListItem(List=round_2.Nearest, Index=0, Wrap=True)  # -> Item, Item1, Item2
panel_11 = Panel("""0
1""")
panel_12 = Panel("""0
1
2
3""")
panel_13 = Panel("""0
1
2
3
4
5""")
random_5 = Random(Range="6", Number=repeat_2, Seed=series_2)  # -> simplify(Random)
pt = Point([popgeo_6, popgeo_7, popgeo, popgeo_3, popgeo_2, popgeo_5])
merge_2 = Merge(Data1=item_5.Item, Data2=item_5.Item1)
division_4 = Division(A=len_4, B=random_4)
mplane = MeshPlane(Boundary=srf_2, WidthCount=item_5.Item, HeightCount=item_5.Item1)  # -> Mesh, Area
item_7 = ListItem(List=random_5, Index=0, Wrap=True)  # -> Item, Item1, Item2
merge_3 = Merge(Data1=item_6.Item, Data2=item_6.Item1)
mplane_2 = MeshPlane(Boundary=srf_3, WidthCount=item_6.Item, HeightCount=item_6.Item1)  # -> Mesh, Area
ma_2 = MassAddition(Input=division_4)  # -> Result, PartialResults
mirror = Mirror(MirrorStrength=100)
multiplication_2 = Multiplication(A=ma_2.Result, B=Slider(0.66, range=0..1))
item_8 = ListItem(List=panel_11, Index=item_7.Item, Wrap=True)
item_9 = ListItem(List=panel_12, Index=item_7.Item1, Wrap=True)
item_10 = ListItem(List=panel_13, Index=item_7.Item2, Wrap=True)
popgeo_9 = PopulateGeometry(Geometry=crv_3, Count=division_4, Seed=1)
random_6 = Random(Range=multiplication_2, Number=lng_4, Seed=2)
faceb = FaceBoundaries(Mesh=mplane.Mesh)
tstat = TreeStatistics(Tree=popgeo_9)  # -> Paths, Length, Count
merge_4 = Merge(Data1=item_8, Data2=item_9)
alongcrv_2 = SortAlongCurve(Points=popgeo_9, Curve=graft(crv_3))  # -> simplify(Points), Indices
faceb_2 = FaceBoundaries(Mesh=mplane_2.Mesh)
tstat_2 = TreeStatistics(Tree=popgeo_8)  # -> Paths, Length, Count
range = Range(Domain=Domain(0, 0.5), Steps=expr("x-1", tstat.Count))
int_2 = Integer(graft(random_6))
lng_5 = ListLength(List=popgeo_9)
range_2 = Range(Domain=Domain(0, 0.5), Steps=expr("x-1", tstat_2.Count))
lng_6 = ListLength(List=popgeo_8)
join = TextJoin(Text=merge_4, Join=";")  # -> flatten(Result)
pt_2 = Point(simplify(alongcrv_2.Points))
join_2 = TextJoin(Text=merge, Join=";")  # -> flatten(Result)
area_2 = Area(Geometry=faceb)  # -> Area, Centroid
addition = Addition(A=int_2, B=graft(range))
area_3 = Area(Geometry=faceb)  # -> Area, Centroid
pt_3 = Point([<point referenced from the Rhino model> x8])
panel_14 = Panel(merge_4)
pt_4 = Point(simplify(alongcrv.Points))
area_4 = Area(Geometry=faceb_2)  # -> Area, Centroid
addition_2 = Addition(A=int, B=graft(range_2))
area_5 = Area(Geometry=faceb_2)  # -> Area, Centroid
series_3 = Series(Start=addition, Step=1, Count=lng_5)  # -> simplify(Series)
repeat_3 = RepeatData(Data=graft(join), Length=lng_5)  # -> simplify(Data)
series_4 = Series(Start=addition_2, Step=1, Count=lng_6)  # -> simplify(Series)
repeat_4 = RepeatData(Data=graft(join_2), Length=lng_6)  # -> simplify(Data)
cp = ClosestPoint(Point=pt_2, Cloud=pt_3)  # -> ClosestPoint, simplify(CPIndex), Distance
smaller_2 = SmallerThan(FirstNumber=cp.Distance, SecondNumber="1.500")  # -> SmallerThan, OrEqualTo
smaller_3 = SmallerThan(FirstNumber=cp.Distance, SecondNumber="1.500")  # -> SmallerThan, OrEqualTo
cull_3 = CullPattern(List=cp.CPIndex, CullPattern=invert(smaller_3.SmallerThan))
cull_4 = CullPattern(List=cp.CPIndex, CullPattern=smaller_2.SmallerThan)
panel_15 = Panel(cull_4)
join_3 = TextJoin(Text=cull_4, Join=";")  # -> flatten(Result)
join_4 = TextJoin(Text=cull_3, Join=";")  # -> flatten(Result)
cp_2 = ClosestPoint(Point=pt_4, Cloud=area_4.Centroid)  # -> ClosestPoint, simplify(CPIndex), Distance
sort = SortList(Keys=flatten(series_3), ValuesA=flatten(cp.CPIndex), ValuesB=flatten(repeat_3))  # -> Keys, ValuesA, ValuesB
brep_8 = Brep([<brep referenced from the Rhino model> x6])
brep_9 = Brep([<brep referenced from the Rhino model> x39])
sort_2 = SortList(Keys=flatten(series_4), ValuesA=flatten(cp_2.CPIndex), ValuesB=flatten(repeat_4))  # -> Keys, ValuesA, ValuesB
pt_5 = Point([<point referenced from the Rhino model> x8])
panel_16 = Panel(repeat_3)
number_slider = Slider(50000, range=0..1000000)
sort_3 = SortList(Keys=flatten(series_3), ValuesA=flatten(cp.CPIndex))  # -> Keys, ValuesA, ValuesB
number_slider_2 = Slider(30000, range=0..1000000)
mesh = MeshBrep(
    Brep=brep_9,
    Settings={GridMaxCount=0, GridMinCount=16, JaggedSeams=False, MaxEdgeLength=0, MinEdgeLength=0.0001, MinTolerance=0, Refine=True, RefineAngle=0, RelativeTolerance=0.65, SimplePlanes=True, Tolerance=0})
mesh_2 = MeshBrep(
    Brep=brep_8,
    Settings={GridMaxCount=0, GridMinCount=16, JaggedSeams=False, MaxEdgeLength=0, MinEdgeLength=0.0001, MinTolerance=0, Refine=True, RefineAngle=0, RelativeTolerance=0.65, SimplePlanes=True, Tolerance=0})
round_3 = Round(Number=sort.Keys)  # -> Nearest, Floor, Ceiling
round_4 = Round(Number=sort_2.Keys)  # -> Nearest, Floor, Ceiling
mjoin = MeshJoin(Meshes=mesh)
mjoin_2 = MeshJoin(Meshes=mesh_2)
round_5 = Round(Number=sort_3.Keys)  # -> Nearest, Floor, Ceiling
panel_17 = Panel(";")
pt_6 = Point(area_2.Centroid)
panel_18 = Panel("""X
Y""")
data = Data(flatten(sort.ValuesB))
popmesh = PopulateMesh(Mesh=mjoin, Amount=number_slider, Normals=False, Seed=2)
pt_7 = Point([<point referenced from the Rhino model> x8])
geo = Geometry([<brep referenced from the Rhino model> x3])
panel_19 = Panel(";")
popmesh_2 = PopulateMesh(Mesh=mjoin_2, Amount=number_slider_2, Normals=False, Seed=2)

panel_20 = Panel(";")
panel_21 = Panel("""X
Y""")
join_5 = TextJoin(Text=merge_3, Join=panel_20)
join_6 = TextJoin(Text=panel_21, Join=panel_20)
merge_5 = Merge(Data1=join_6, Data2=join_5)  # -> flatten(Result)
panel_22 = Panel(merge_5)

geo_2 = Geometry([<brep referenced from the Rhino model> x3])
pt_8 = Point(area_4.Centroid)
pdecon = Deconstruct(Point=pt_8)  # -> XComponent, YComponent, ZComponent
index = ItemIndex(List=pt_8, Item=pt_8)
pull = PullPoint(Point=pt_8, Geometry=geo_2, ClosestOnly=False)  # -> ClosestPoint, Distance
item_11 = ListItem(List=pull.Distance, Index=0, Wrap=True)  # -> flatten(Item), flatten(Item1), flatten(Item2)
concat = Concatenate(
    FragmentD=index,
    FragmentA=pdecon.XComponent,
    FragmentB=pdecon.ZComponent,
    FragmentC=pdecon.YComponent,
    FragmentE=item_11.Item,
    FragmentF=item_11.Item1,
    FragmentG=item_11.Item2,
    JoinSeparator=";")
merge_6 = Merge(Data1="id;X;Y;Z;dist1;dist2;dist3", Data2=concat)  # -> flatten(Result)
panel_23 = Panel(merge_6)

data_2 = Data(flatten(sort_3.ValuesB))
panel_24 = Panel(";")
swatch = ColourSwatch(SwatchColor=RGB(204, 200, 200))
join_7 = TextJoin(Text=merge_2, Join=panel_17)
join_8 = TextJoin(Text=panel_18, Join=panel_17)
swatch_2 = ColourSwatch(SwatchColor=RGB(255, 255, 255))
deconstruct = DeconstructPointCloud(PointCloud=popmesh)  # -> Points, Colours, Normals
split = TextSplit(Text=data, Separators=panel_19)  # -> simplify(Result)
deconstruct_2 = DeconstructPointCloud(PointCloud=popmesh_2)  # -> Points, Colours, Normals
split_2 = TextSplit(Text=data_2, Separators=panel_24)  # -> simplify(Result)
merge_7 = Merge(Data1=graft(round_3.Floor), Data2=graft(sort.ValuesA))  # -> simplify(Result)
merge_8 = Merge(Data1=graft(round_5.Floor), Data2=graft(sort_3.ValuesA))  # -> simplify(Result)
merge_9 = Merge(Data1=join_8, Data2=join_7)  # -> flatten(Result)
pdecon_2 = Deconstruct(Point=pt_6)  # -> XComponent, YComponent, ZComponent
data_3 = Data(split_2)
repeat_5 = RepeatData(Data=swatch, Length=number_slider)
index_2 = ItemIndex(List=pt_6, Item=pt_6)
pull_2 = PullPoint(Point=pt_6, Geometry=pt_7, ClosestOnly=False)  # -> ClosestPoint, Distance
data_4 = Data(split)
repeat_6 = RepeatData(Data=swatch, Length=number_slider_2)
construct = ConstructPointCloud(Points=deconstruct.Points, Colours=repeat_5)
panel_25 = Panel(merge_8)
number_slider_3 = Slider(0.5, range=0..1)
panel_26 = Panel(merge_9)
ins = InsertItems(List=data_3, Item=merge_8, Indices="0", Wrap=True)
construct_2 = ConstructPointCloud(Points=deconstruct_2.Points, Colours=repeat_6)
item_12 = ListItem(List=pull_2.Distance, Index=0, Wrap=True)  # -> flatten(Item), flatten(Item1), flatten(Item2)
ins_2 = InsertItems(List=data_4, Item=merge_7, Indices="0", Wrap=True)
panel_27 = Panel("""timestamp 
gaze 
object 
interaction""")
panel_28 = Panel(ins_2)
flip = FlipMatrix(Data=ins_2)
flip_2 = FlipMatrix(Data=ins)
preview = PreviewPointCloud(PointCloud=construct_2, Weight=number_slider_3)
preview_2 = PreviewPointCloud(PointCloud=construct, Weight=number_slider_3)
concat_2 = Concatenate(
    FragmentD=index_2,
    FragmentA=pdecon_2.XComponent,
    FragmentB=pdecon_2.ZComponent,
    FragmentC=pdecon_2.YComponent,
    FragmentE=item_12.Item,
    FragmentF=item_12.Item1,
    FragmentG=item_12.Item2,
    JoinSeparator=";")
merge_10 = Merge()
panel_29 = Panel("grid_values.json")
datatable = CreateDataTable(TableName="data", TableHeaders=panel_27, ValueTree=simplify(flip))  # -> flatten(DataTable)
merge_11 = Merge(Data1="id;X;Y;Z;dist1;dist2;dist3", Data2=concat_2)  # -> flatten(Result)
panel_30 = Panel("grid_values_10.json")
path = FilePath("C:\Users\nerii\Desktop\Work\Noumena\NEX-UI\Nex_viz\models\json\")

merge_12 = MergePointClouds(PointClouds=[construct, construct_2])
deconstruct_3 = DeconstructPointCloud(PointCloud=merge_12)  # -> Points, Colours, Normals
pdecon_3 = Deconstruct(Point=pt)  # -> XComponent, YComponent, ZComponent
concat_3 = Concatenate(FragmentA=pdecon_3.XComponent, FragmentB=pdecon_3.ZComponent, FragmentC=pdecon_3.YComponent, JoinSeparator=";")
merge_13 = Merge(Data1="X;Y;Z", Data2=concat_3)  # -> flatten(Result)
panel_32 = Panel(merge_13)

path_2 = FilePath("C:\Users\secg\Documents\Noumena\projects\221222_NEX_GRUPOSALINAS\04_UI\NEX-UI-c2a8a364ba652091d0f82dd2396771d7a5440c39\models\json\")
panel_33 = Panel(merge_11)
path_3 = FilePath("C:\Users\secg\Documents\Noumena\projects\221222_NEX_GRUPOSALINAS\04_UI\NEX-UI-c2a8a364ba652091d0f82dd2396771d7a5440c39\models\json\")

data_5 = Data(flatten(sort_2.ValuesB))
panel_34 = Panel(";")
split_3 = TextSplit(Text=data_5, Separators=panel_34)  # -> simplify(Result)
merge_14 = Merge(Data1=graft(round_4.Floor), Data2=graft(sort_2.ValuesA))  # -> simplify(Result)
data_6 = Data(split_3)
ins_3 = InsertItems(List=data_6, Item=merge_14, Indices="0", Wrap=True)
flip_3 = FlipMatrix(Data=ins_3)
panel_35 = Panel("""timestamp
id
gender
age
group""")
datatable_2 = CreateDataTable(TableName="data", TableHeaders=panel_35, ValueTree=simplify(flip_3))  # -> flatten(DataTable)
path_4 = FilePath("C:\Users\nerii\Desktop\Work\Noumena\NEX-UI\Nex_viz\models\json\")
concat_4 = Concatenate(FragmentA=path_3, FragmentB="grid_values_10.json")
dataset = CreateDataSet(DataSetName="data", DataTables=datatable_2)
path_5 = FilePath(concat_4)
json = CreateJSON(WriteJSON=Button(), FilePath=path_5, DataSet=dataset)

panel_36 = Panel(path_2)
panel_37 = Panel("""X;Y;Z
17.345852;0;12.985688
24.879693;0;15.991821
23.901891;0;8.977426
16.625187;0;7.405127
20.007527;0;9.325776
20.435495;0;14.568391
15.015772;0;10.212269
22.933237;0;11.491371
17.473834;0;15.586952
15.012151;0;13.922354
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""")
concat_5 = Concatenate(FragmentA=path_2, FragmentB="prod_values_11.json")
panel_38 = Panel(path_3)
dataset_2 = CreateDataSet(DataSetName="data", DataTables=datatable)
path_6 = FilePath(concat_5)
json_2 = CreateJSON(WriteJSON=Button(), FilePath=path_6, DataSet=dataset_2)
cull_i = CullIndex(List=panel_37, Indices="0", Wrap=True)
split_4 = TextSplit(Text=cull_i)
