# Grasshopper definition mesh_grid_r4_salva.gh (Grasshopper 1.0.7)
# plug-ins: LunchBox, Geospatial, EF - R7 Beta

srf = Surface(<surface referenced from the Rhino model>)

# ---- group: day_06
crv = Curve([<curve referenced from the Rhino model> x37])

# ---- group: day_07
crv_2 = Curve([<curve referenced from the Rhino model> x44])

# ---- group: day_02
crv_3 = Curve([<curve referenced from the Rhino model> x32])

# ---- group: day_03
crv_4 = Curve([<curve referenced from the Rhino model> x34])

# ---- group: day_04
crv_5 = Curve([<curve referenced from the Rhino model> x31])

# ---- group: day_05
crv_6 = Curve([<curve referenced from the Rhino model> x34])

# ---- group: day_01
# data_days
crv_7 = Curve([<curve referenced from the Rhino model> x25])

# ----
srf_2 = Surface(<surface referenced from the Rhino model>)

# ---- group: Interaction
crv_8 = Curve([<curve referenced from the Rhino model> x15])

# ----
srf_3 = Surface(srf_2)
trim = TrimWithRegion(Curve=crv_8, Region=srf_3)  # -> flatten(Inside), Outside
rec = Rectangle(srf_3)
crv_9 = Curve(trim.Inside)
explode = Explode(Curve=rec, Recursive=True)  # -> Segments, Vertices
len = Length(Curve=explode.Segments)

# ---- group: Profile
crv_10 = Curve(crv_9)
lng = ListLength(List=crv_10)
repeat = RepeatData(Data="3", Length=lng)
panel = Panel("""M
F""")
series = Series(Start=0, Step=1, Count=lng)
panel_2 = Panel("""1
2
3
4""")
panel_3 = Panel("""CA
IN
AS
ME
AF
OT""")
panel_4 = Panel("""1
1.6
1.9
1.5""")
panel_5 = Panel("""0
1
2
3""")
panel_6 = Panel("""0
1""")
panel_7 = Panel("""0
1
2
3
4
5""")
random = Random(Range="6", Number=repeat, Seed=series)  # -> simplify(Random)
item = ListItem(List=random, Index=0, Wrap=True)  # -> Item, Item1, Item2
int = Integer(graft(series))
item_2 = ListItem(List=panel_6, Index=item.Item, Wrap=True)
item_3 = ListItem(List=panel_5, Index=item.Item1, Wrap=True)
item_4 = ListItem(List=panel_7, Index=item.Item2, Wrap=True)
item_5 = ListItem(List=panel_4, Index=item.Item1, Wrap=True)
merge = Merge(Data1=simplify(item_2), Data2=simplify(item_3), Data3=simplify(item_4), Data4=simplify(int))

# ----
multiplication = Multiplication(A="1000", B=Slider(0.2, range=0..1))
multiplication_2 = Multiplication(A="1000", B=Slider(0.3, range=0..1))
multiplication_3 = Multiplication(A=Slider(0.25, range=0..1), B="1000")

division = Division(A=len, B=Slider(0.25, range=0..1))
round = Round(Number=division)  # -> Nearest, Floor, Ceiling

lng_2 = ListLength(List=crv_9)
dom = ConstructDomain(DomainStart=Slider(0.2, range=0..1), DomainEnd=Slider(0.3, range=0..1))
len_2 = Length(Curve=crv_9)
random_2 = Random(Range=dom, Number=lng_2, Seed=2)
division_2 = Division(A=len_2, B=random_2)
ma = MassAddition(Input=division_2)  # -> Result, PartialResults
multiplication_4 = Multiplication(A=ma.Result, B=Slider(0.66, range=0..1))
popgeo = PopulateGeometry(Geometry=crv_9, Count=division_2, Seed=1)
random_3 = Random(Range=multiplication_4, Number=lng_2, Seed=2)
alongcrv = SortAlongCurve(Points=popgeo, Curve=graft(crv_9))  # -> simplify(Points), Indices
int_2 = Integer(graft(random_3))
lng_3 = ListLength(List=popgeo)

bnd = Bounds(Numbers=division_2)
item_6 = ListItem(List=round.Nearest, Index=0, Wrap=True)  # -> Item, Item1, Item2
random_4 = Random(Range=bnd, Number=Slider(1300, range=0..10000), Seed=2)
merge_2 = Merge(Data1=item_6.Item, Data2=item_6.Item1)
mplane = MeshPlane(Boundary=srf_3, WidthCount=item_6.Item, HeightCount=item_6.Item1)  # -> Mesh, Area
faceb = FaceBoundaries(Mesh=mplane.Mesh)
lng_4 = ListLength(List=division_2)
multiplication_5 = Multiplication(A="3600", B="5")
multiplication_6 = Multiplication(A="5", B=Slider(6, range=0..10))

brep = Brep([<brep referenced from the Rhino model> x60])
brep_2 = Brep([<brep referenced from the Rhino model> x60])
merge_3 = Merge(Data1=brep, Data2=brep_2)
area = Area(Geometry=merge_3)  # -> Area, Centroid

unix_time_18th_sept_2022_14_00 = Panel("1663329600")
random_5 = Random(Range="2 to 5", Number=multiplication_6, Seed=Slider(10, range=0..100))
range = Range(Domain=multiplication_5, Steps=multiplication_6)
random_6 = Random(Range="2 to 5", Number=multiplication_6, Seed=Slider(34, range=0..100))
number_slider = Slider(250, range=0..1000)
round_2 = Round(Number=random_5)  # -> Nearest, Floor, Ceiling
round_3 = Round(Number=random_6)  # -> Nearest, Floor, Ceiling
addition = Addition(A=range, B=unix_time_18th_sept_2022_14_00)
pt = Point([<point referenced from the Rhino model> x33])
pt_2 = Point(pt)
entwine = Entwine(Branch00=addition, Branch01=round_3.Nearest, Branch02=round_2.Nearest, FlattenInputs=True)
Z = UnitZ(Factor=Slider(0.25, range=0..1))
genes = GenePool(Decimals=2, Maximum=100, Minimum=0, Value=[49.13, 37.21, 26.12, 3.94, 15.25, 22.53])
repeat_2 = RepeatData(Data="left", Length="60")
repeat_3 = RepeatData(Data="right", Length="60")
join = TextJoin(Text=merge, Join=";")  # -> flatten(Result)
area_2 = Area(Geometry=faceb)  # -> Area, Centroid
index = ItemIndex(List=pt, Item=pt)
number_slider_2 = Slider(120, range=0..1000)
move = Move(Geometry=pt, Motion=Z)  # -> Geometry, Transform
pt_3 = Point(simplify(alongcrv.Points))
pt_4 = Point(pt_3)
merge_4 = Merge(Data1=repeat_2, Data2=repeat_3)
flip = FlipMatrix(Data=entwine)
textdot = DefineTextDot(Text=index, Location=area.Centroid, Font="Arial", Size=14)
repeat_4 = RepeatData(Data=graft(join), Length=lng_3)  # -> simplify(Data)
ma_2 = MassAddition(Input=genes)  # -> Result, PartialResults
join_2 = TextJoin(Text=flip, Join=";")
cluster = Cluster(S=pt_4, A=item_5, num="1000", A_2=Slider(4, range=0..10))  # -> G, i
lng_5 = ListLength(List=pt_2)
cp = ClosestPoint(Point=pt_3, Cloud=area_2.Centroid)  # -> ClosestPoint, simplify(CPIndex), Distance
remap = RemapNumbers(Value=genes, Source=ma_2.Result, Target=lng_5)  # -> Mapped, Clipped
merge_5 = Merge(Data1=simplify(cluster.G), Data2=simplify(cluster.i))
merge_6 = Merge(Data1="timestamp;cash;cash_m;", Data2=join_2)  # -> flatten(Result)
panel_8 = Panel("""Nike
Nike Air
Adidas
Balencia
Nike Dunk
Converse""")
round_4 = Round(Number=remap.Mapped)  # -> Nearest, Floor, Ceiling
group = Group(Objects=merge_5)  # -> flatten(Group)
panel_9 = Panel(merge_6)
index_2 = ItemIndex(List=pt_2, Item=pt_2)
series_2 = Series(Start=0, Step=1, Count=round_4.Nearest)
repeat_5 = RepeatData(Data=graft(panel_8), Length=graft(round_4.Nearest))  # -> flatten(Data)
concat = Concatenate(FragmentA="product_", FragmentB=series_2)  # -> flatten(Result)
random_7 = Random(Range="0 to 17", Number=lng_5, Seed=2)
jitter = Jitter(List=repeat_5, Jitter=Slider(0.9, range=0..1), Seed=2)  # -> Values, Indices
round_5 = Round(Number=random_7)  # -> Nearest, Floor, Ceiling
item_7 = ListItem(List=concat, Index=jitter.Indices, Wrap=True)
concat_2 = Concatenate(FragmentA="2022/10/", FragmentB=round_5.Nearest)
entwine_2 = Entwine(Branch00=merge_4, Branch01=index_2, Branch02=jitter.Values, Branch03=item_7, Branch04=concat_2, FlattenInputs=True)
flip_2 = FlipMatrix(Data=entwine_2)
geo = Geometry([<brep referenced from the Rhino model> x3])

geo_2 = Geometry([<brep referenced from the Rhino model> x2, <curve referenced from the Rhino model>])
pt_5 = Point(move.Geometry)
scale = Scale(Geometry=pt_5, Center=Point(0, 0, 0), Factor="1")  # -> Geometry, Transform
pdecon = Deconstruct(Point=scale.Geometry)  # -> XComponent, YComponent, ZComponent
pull = PullPoint(Point=pt_5, Geometry=geo, ClosestOnly=False)  # -> ClosestPoint, Distance
index_3 = ItemIndex(List=pt_5, Item=pt_5)
multiplication_7 = Multiplication(A=pull.Distance, B="1")
int_3 = Integer("2")
eval = Evaluate(F="round(x,y)", x=multiplication_7, y=int_3)
item_8 = ListItem(List=eval, Index=0, Wrap=True)  # -> flatten(Item), flatten(Item1), flatten(Item2)
concat_3 = Concatenate(
    FragmentD=index_3,
    FragmentA=pdecon.XComponent,
    FragmentB=pdecon.ZComponent,
    FragmentC=pdecon.YComponent,
    FragmentE=item_8.Item,
    FragmentF=item_8.Item1,
    FragmentG=item_8.Item2,
    JoinSeparator=";")
merge_7 = Merge(Data1="id;X;Y;Z;dist1;dist2;dist3", Data2=concat_3)  # -> flatten(Result)
panel_10 = Panel(merge_7)

panel_11 = Panel(";")
panel_12 = Panel("""X
Y""")
join_3 = TextJoin(Text=merge_2, Join=panel_11)
join_4 = TextJoin(Text=panel_12, Join=panel_11)
merge_8 = Merge(Data1=join_4, Data2=join_3)  # -> flatten(Result)
panel_13 = Panel(merge_8)  # disabled

geo_3 = Geometry([<brep referenced from the Rhino model> x3])

crv_11 = Curve(<curve referenced from the Rhino model>)
# Entrance Triangle
disc = Discontinuity(Curve=crv_11, Level=1)  # -> Points, Parameters
scale_2 = Scale(Geometry=disc.Points, Center=Point(0, 0, 0), Factor="1")  # -> Geometry, Transform
pdecon_2 = Deconstruct(Point=scale_2.Geometry)  # -> XComponent, YComponent, ZComponent
concat_4 = Concatenate(FragmentA=pdecon_2.XComponent, FragmentB=pdecon_2.YComponent, FragmentC=pdecon_2.ZComponent, JoinSeparator=",")
panel_14 = Panel(concat_4)

geo_4 = Geometry([<brep referenced from the Rhino model> x2, <curve referenced from the Rhino model>])
pt_6 = Point(area_2.Centroid)
scale_3 = Scale(Geometry=pt_6, Center=Point(0, 0, 0), Factor="1")  # -> Geometry, Transform
pull_2 = PullPoint(Point=graft(pt_6), Geometry=geo_3, ClosestOnly=False)  # -> ClosestPoint, simplify(Distance)
pdecon_3 = Deconstruct(Point=scale_3.Geometry)  # -> XComponent, YComponent, ZComponent
index_4 = ItemIndex(List=pt_6, Item=pt_6)
multiplication_8 = Multiplication(A=pull_2.Distance, B="1")
int_4 = Integer("2")
eval_2 = Evaluate(F="round(x,y)", x=multiplication_8, y=int_4)
item_9 = ListItem(List=eval_2, Index=0, Wrap=True)  # -> flatten(Item), flatten(Item1), flatten(Item2)
concat_5 = Concatenate(
    FragmentD=index_4,
    FragmentA=pdecon_3.XComponent,
    FragmentB=pdecon_3.ZComponent,
    FragmentC=pdecon_3.YComponent,
    FragmentE=item_9.Item,
    FragmentF=item_9.Item1,
    FragmentG=item_9.Item2,
    JoinSeparator=";")
merge_9 = Merge(Data1="id;X;Y;Z;dist1;dist2;dist3", Data2=concat_5)  # -> flatten(Result)
panel_15 = Panel(merge_9)

join_5 = TextJoin(Text=flip_2, Join=";")  # -> flatten(Result)
multiplication_9 = Multiplication(A="1000", B=Slider(2, range=0..10))
index_5 = ItemIndex(List=move.Geometry, Item=move.Geometry)
merge_10 = Merge(Data1="side;cell_id;brand;product;date", Data2=join_5)  # -> flatten(Result)
panel_16 = Panel(merge_10)
panel_17 = Panel("""timestamp
gaze
object
interaction""")
path = FilePath("C:\Users\secg\Documents\Noumena\projects\221222_NEX_GRUPOSALINAS\04_UI\NEX-UI-c2a8a364ba652091d0f82dd2396771d7a5440c39\models\json\")
path_2 = FilePath("C:\Users\secg\Documents\Noumena\projects\221222_NEX_GRUPOSALINAS\04_UI\NEX-UI-c2a8a364ba652091d0f82dd2396771d7a5440c39\models\json\")
path_3 = FilePath("C:\Users\nerii\Desktop\Work\Noumena\NEX-UI\Nex_viz\models\json\")

number_slider_3 = Slider(2000, range=0..10000)
bnd_2 = Bounds(Numbers=flatten(division_2))
dedomain = DeconstructDomain(Domain=bnd_2)  # -> Start, End
multiplication_10 = Multiplication(A="3600", B="5")
subtraction = Subtraction(A=number_slider_3, B=dedomain.End, C="1")
range_2 = Range(Domain=multiplication_10, Steps=number_slider_3)
random_8 = Random(Range=subtraction, Number=lng_4, Seed=2)
series_3 = Series(Start=0, Step=1, Count=subtraction)
unix_time_18th_sept_2022_14_00_2 = Panel("1663329600")
item_10 = ListItem(List=series_3, Index=random_8, Wrap=True)

int_5 = Integer(range_2)

split = SplitList(List=int_5, Index=graft(item_10))  # -> ListA, ListB
split_2 = SplitList(List=split.ListB, Index=graft(division_2))  # -> ListA, ListB
addition_2 = Addition(A=split_2.ListA, B=unix_time_18th_sept_2022_14_00_2)

sort = SortList(Keys=flatten(addition_2), ValuesA=flatten(cp.CPIndex), ValuesB=flatten(repeat_4), ValuesC=flatten(addition_2))  # -> Keys, ValuesA, ValuesB, ValuesC, ValuesD
sort_2 = SortList(Keys=flatten(addition_2), ValuesA=flatten(group), ValuesB=flatten(repeat_4))  # -> Keys, ValuesA, ValuesB, ValuesD
ungroup = Ungroup(Group=sort_2.ValuesA)
item_11 = ListItem(List=ungroup, Index=0, Wrap=True)  # -> flatten(Item), flatten(Item1)
int_6 = Integer(sort_2.Keys)

data = Data(flatten(sort.ValuesB))
panel_18 = Panel(";")
split_3 = TextSplit(Text=data, Separators=panel_18)  # -> simplify(Result)
merge_11 = Merge(Data1=graft(sort.ValuesC), Data2=graft(sort.ValuesA))  # -> simplify(Result)
data_2 = Data(split_3)
ins = InsertItems(List=data_2, Item=merge_11, Indices="0", Wrap=True)
flip_3 = FlipMatrix(Data=ins)
panel_19 = Panel("""timestamp
id
gender
age
group
person""")
datatable = CreateDataTable(TableName="data", TableHeaders=panel_19, ValueTree=simplify(flip_3))  # -> flatten(DataTable)
path_4 = FilePath("C:\Users\nerii\Desktop\Work\Noumena\NEX-UI\Nex_viz\models\json\")
concat_6 = Concatenate(FragmentA=path, FragmentB="grid_values_10.json")
dataset = CreateDataSet(DataSetName="data", DataTables=datatable)
path_5 = FilePath(concat_6)
json = CreateJSON(WriteJSON=Button(), FilePath=path_5, DataSet=dataset)

lng_6 = ListLength(List=item_11.Item)
project = ProjectPoint(Point=move.Geometry, Direction=Vector(0, 0, -1), Geometry=graft(item_11.Item))  # -> Point, Index
cps = ClosestPoints(Point=item_11.Item1, Cloud=move.Geometry, Count=Slider(5, range=0..10))  # -> ClosestPoint, CPIndex, Distance
larger = LargerThan(FirstNumber=cps.Distance, SecondNumber=multiplication_9)  # -> LargerThan, OrEqualTo
null = NullItem(Item=project.Point)  # -> NullFlags, InvalidFlags, Description
cull = CullPattern(List=cps.CPIndex, CullPattern=invert(larger.LargerThan))
cull_2 = CullPattern(List=index_5, CullPattern=invert(null.NullFlags))  # -> simplify(List)
graft = GraftTree(Tree=int_6, IncludeEmptyLists=True, IncludeNullItems=True)  # -> simplify(Tree)
item_12 = ListItem(List=cull, Index=0, Wrap=True)  # -> simplify(Item)
data_3 = Data(simplify(cull))
panel_20 = Panel(cps.CPIndex)
entwine_3 = Entwine(Branch0X=graft, Branch1X=cull_2, Branch2X=item_12, Branch3X=data_3, FlattenInputs=False)
path_mapper = PathMapper(entwine_3, source="{A;B}", target="{B;A}")
repeat_6 = RepeatData(Data=graft(panel_17), Length=lng_6)
data_4 = Data(path_mapper)
flip_4 = FlipMatrix(Data=repeat_6)  # -> simplify(graft(Data))
panel_21 = Panel(entwine_3)
merge_12 = Merge(Data1=flip_4, Data2=data_4)
cluster_2 = Cluster_2(L=merge_12)
write_file = WriteFile(Directory=path_2, Filename="prod_values_10.json", Data=cluster_2, Run=Button(), Overwrite=Toggle(True))

# ==== cluster Cluster
num = ClusterInput()
A = ClusterInput()
num_2 = Number(num)
A_2 = ClusterInput()
multiplication = Multiplication(A=A, B=num_2)
multiplication_2 = Multiplication(A=A_2, B=num_2)
S = ClusterInput()
line = LineSDL(Start=S, Direction=Vector(0, 0, 1), Length=multiplication)
end = EndPoints(Curve=line)  # -> Start, End
shift = ShiftList(List=end.End, Shift=1, Wrap=invert(True))
short = ShortestList(ListA=end.End, ListB=shift, TrimMode=2)  # -> ListA, ListB
vec2pt = Vector2Pt(PointA=short.ListA, PointB=short.ListB, Unitize=False)  # -> Vector, Length
long = LongestList(ListA=end.End, ListB=vec2pt.Vector, PaddingMode=2)  # -> ListA, ListB
Z = UnitZ(Factor=1)
vrot = Rotate(Vector=long.ListB, Axis=Z, Angle=degrees(90))
division = Division(A=multiplication_2, B="2")
amp = Amplitude(Vector=long.ListB, Amplitude=multiplication_2)
amp_2 = Amplitude(Vector=vrot, Amplitude=division)
neg = Negative(Value=amp_2)
addition = Addition(A=amp, B=amp_2)
addition_2 = Addition(A=amp, B=neg)
move = Move(Geometry=long.ListA, Motion=addition)  # -> Geometry, Transform
move_2 = Move(Geometry=long.ListA, Motion=addition_2)  # -> Geometry, Transform
merge = Merge(Data1=graft(long.ListA), Data2=graft(move.Geometry), Data3=graft(move_2.Geometry))
conmesh = ConstructMesh(Vertices=merge, Faces={A=0, B=1, C=2, D=2})  # -> simplify(Mesh)
project = Project(Geometry=conmesh, Plane=PlaneXY(0, 0, 0))  # -> Geometry, Transform
item = ListItem(List=merge, Index=0, Wrap=True)  # -> simplify(Item)
i = ClusterOutput(item)
G = ClusterOutput(project.Geometry)

# ==== cluster Cluster_2
L = ClusterInput()
split = SplitList(List=L, Index="1")  # -> simplify(ListA), simplify(ListB)
data = Data(simplify(split.ListB))
lng = ListLength(List=data)
concat = Concatenate(FragmentA="\"", FragmentB=split.ListA, FragmentC="\":")
larger = LargerThan(FirstNumber=lng, SecondNumber="1")  # -> LargerThan, OrEqualTo
equals = Equality(FirstNumber=lng, SecondNumber="0")  # -> Equality, Inequality
or = GateOr(A=larger.LargerThan, B=equals.Equality)
dispatch = Dispatch(List=data, DispatchPattern=or)  # -> ListA, ListB
panel = Panel(data)
join = TextJoin(Text=dispatch.ListA, Join=",")
not = GateNot(A=or)
concat_2 = Concatenate(FragmentA="[", FragmentB=join, FragmentC="]")
weave = Weave(Pattern=not, Stream0=concat_2, Stream1=dispatch.ListB, NullGaps=False)
panel_2 = Panel(weave)
merge = Merge(Data1=concat, Data2=weave)
join_2 = TextJoin(Text=merge, Join=" ")
trim = TrimTree(Tree=join_2, Depth=1)
join_3 = TextJoin(Text=trim, Join=", ")
concat_3 = Concatenate(FragmentA="{", FragmentB=join_3, FragmentC="}")  # -> flatten(Result)
join_4 = TextJoin(Text=concat_3, Join=", ")
panel_3 = Panel("""{
  "data": [""")
concat_4 = Concatenate(FragmentA=panel_3, FragmentB=join_4, FragmentC="]}")
R = ClusterOutput(concat_4)
